# Grasshopper definition algorithm.gh (Grasshopper 1.0.4)

width = Slider(136, range=130..140)
temple_height = Slider(4, range=0..10)
front_frame_thickness = Slider(2.039, range=2..2.5)
pd = Slider(68, range=65..70)
bottom_temple = Slider(45.164, range=-1..50)
top_temple = Slider(1.397, range=-1..50)
lens = Geometry(<curve referenced from the Rhino model>)

# ---- group: inner lens
connect = ConnectCurves(Curves=lens, Continuity=2, Close=True, Bulge=1)
closed_lens = Geometry(connect)
area = Area(Geometry=closed_lens)  # -> Area, Centroid
centerpoint = Point(area.Centroid)
pdecon = Deconstruct(Point=centerpoint)  # -> XComponent, YComponent, ZComponent
number = Number(-1)
number_2 = Number(-1)
multiplication = Multiplication(A=pdecon.YComponent, B=number)
multiplication_2 = Multiplication(A=number_2, B=pdecon.XComponent)
X = UnitX(Factor=multiplication_2)
Y = UnitY(Factor=multiplication)
move = Move(Geometry=lens, Motion=X)  # -> Geometry, Transform
move_2 = Move(Geometry=move.Geometry, Motion=Y)  # -> Geometry, Transform
inner_lens = Geometry(move_2.Geometry)

# ---- group: side
side_height = Slider(5.75, range=5.75..6.25)
division = Division(A=width, B=2)
Y_2 = UnitY(Factor=temple_height)
division_2 = Division(A=width, B=2)
_0 = Number(0)
_0_2 = Number(0)
_0_3 = Number(0)
pt = ConstructPoint(XCoordinate=division, YCoordinate=side_height, ZCoordinate=_0)
pt_2 = ConstructPoint(XCoordinate=division_2, YCoordinate=_0_2, ZCoordinate=_0_3)
move_3 = Move(Geometry=pt, Motion=Y_2)  # -> Geometry, Transform
move_4 = Move(Geometry=pt_2, Motion=Y_2)  # -> Geometry, Transform
top_right_point = Point(move_3.Geometry)
bottom_right_point = Point(move_4.Geometry)
ln = Line(StartPoint=move_3.Geometry, EndPoint=move_4.Geometry)
side = Geometry(ln)

# ---- group: move PD
_2 = Number(2)
division_3 = Division(A=pd, B=_2)
X_2 = UnitX(Factor=division_3)
move_5 = Move(Geometry=inner_lens, Motion=X_2)  # -> Geometry, Transform

# ---- group: outer frame
offset = Offset(Curve=move_5.Geometry, Distance=front_frame_thickness, Plane=PlaneXY(0, 0, 0), Corners=1)  # -> flatten(Curve)
outer_frame = Geometry(offset)

# ----
eval = EvaluateCurve()  # -> Point, Tangent, Angle

# ---- group: temple
addition = Addition(A=top_temple, B=0.1)
addition_2 = Addition(A=bottom_temple, B=0.1)
eval_2 = EvaluateCurve(Curve=outer_frame, Parameter=addition)  # -> Point, Tangent, Angle
eval_3 = EvaluateCurve(Curve=outer_frame, Parameter=top_temple)  # -> Point, Tangent, Angle
eval_4 = EvaluateCurve(Curve=outer_frame, Parameter=addition_2)  # -> Point, Tangent, Angle
eval_5 = EvaluateCurve(Curve=outer_frame, Parameter=bottom_temple)  # -> Point, Tangent, Angle
intcrv = Interpolate(Vertices=[eval_5.Point, eval_4.Point, bottom_right_point], Degree=3, Periodic=False, KnotStyle=1)  # -> Curve, Length, Domain
intcrv_2 = Interpolate(Vertices=[eval_2.Point, eval_3.Point, top_right_point], Degree=3, Periodic=False, KnotStyle=1)  # -> Curve, Length, Domain
top_temple_2 = Geometry(intcrv_2.Curve)
bottom_temple_2 = Geometry(intcrv.Curve)
